# Grasshopper definition extended version.gh (Grasshopper 1.0.8)
# plug-ins: Pufferfish, PTComponentLibrary, Wombat

number_slider = Slider(30, range=0..100)
number_slider_2 = Slider(400, range=0..1000)
dom = ConstructDomain(DomainStart=Slider(0.333, range=0.333..0.667), DomainEnd=Slider(0.667, range=0.333..0.667))
panel = Panel("""0
1
1
1""")

# ---- group: Ideal curve (6.5m rod)
width_of_arcs = Slider(121, range=0..1000)
distance_between_arcs = Slider(31, range=0..100)
number_slider_3 = Slider(600, range=0..1000)
neg = Negative(Value=width_of_arcs)
number_slider_4 = Slider(600, range=0..1000)
xz = XZPlane(Origin=Point(0, 0, 0))
xz_2 = XZPlane(Origin=Point(0, 0, 0))
xz_3 = XZPlane(Origin=Point(0, 0, 0))
xz_4 = XZPlane(Origin=Point(0, 0, 0))

# ----
subtraction = Subtraction(A=width_of_arcs, B=distance_between_arcs)

# ---- group: Ideal curve (6.5m rod)
width = Slider(183.21, range=-130..400)
height = Slider(200, range=0..200)
angle = Slider(110.7, range=0..170)
pt = ConstructPoint(XCoordinate=width_of_arcs, YCoordinate=0, ZCoordinate=0)
pt_2 = ConstructPoint(XCoordinate=neg, YCoordinate=0, ZCoordinate=0)
rad = Radians(Degrees=angle)
vb = VBScript(PtA=pt_2, PtB=pt, Pln=xz, Len=number_slider_4)  # -> out, Pts, Crv, L, W, H, A, F; inputs PtA: Point3d, PtB: Point3d, Pln: Plane
# ---------- vb: VB ----------
    ' -----------------------------------------------------------------
    ' Elastic Bending Script by Will McElwain
    ' Created February 2014
    '
    ' DESCRIPTION:
    ' This beast creates the so-called 'elastica curve', the shape a long, thin rod or wire makes when it is bent elastically (i.e. not permanently). In this case, force
    ' is assumed to only be applied horizontally (which would be in line with the rod at rest) and both ends are assumed to be pinned or hinged meaning they are free
    ' to rotate (as opposed to clamped, when the end tangent angle is fixed, usually horizontally). An interesting finding is that it doesn't matter what the material or
    ' cross-sectional area is, as long as they're uniform along the entire length. Everything makes the same shape when bent as long as it doesn't cross the threshold
    ' from elastic to plastic (permanent) deformation (I don't bother to find that limit here, but can be found if the yield stress for a material is known).
    '
    ' Key to the formulas used in this script are elliptic integrals, specifically K(m), the complete elliptic integral of the first kind, and E(m), the complete elliptic
    ' integral of the second kind. There was a lot of confusion over the 'm' and 'k' parameters for these functions, as some people use them interchangeably, but they are
    ' not the same. m = k^2 (thus k = Sqrt(m)). I try to use the 'm' parameter exclusively to avoid this confusion. Note that there is a unique 'm' parameter for every
    ' configuration/shape of the elastica curve.
    '
    ' This script tries to find that unique 'm' parameter based on the inputs. The algorithm starts with a test version of m, evaluates an expression, say 2*E(m)/K(m)-1,
    ' then compares the result to what it should be (in this case, a known width/length ratio). Iterate until the correct m is found. Once we have m, we can then calculate
    ' all of the other unknowns, then find points that lie on that curve, then interpolate those points for the actual curve. You can also use Wolfram|Alpha as I did to
    ' find the m parameter based on the equations in this script (example here: http://tiny.cc/t4tpbx for when say width=45.2 and length=67.1).
    '
    ' Other notes:
    ' * This script works with negative values for width, which will creat a self-intersecting curve (as it should). The curvature of the elastica starts to break down around
    ' m=0.95 (~154°), but this script will continue to work until M_MAX, m=0.993 (~169°). If you wish to ignore self-intersecting curves, set ignoreSelfIntersecting to True
    ' * When the only known values are length and height, it is actually possible for certain ratios of height to length to have two valid m values (thus 2 possible widths
    ' and angles). This script will return them both.
    ' * Only the first two valid parameters (of the required ones) will be used, meaning if all four are connected (length, width or a PtB, height, and angle), this script will
    ' only use length and width (or a PtB).
    ' * Depending on the magnitude of your inputs (say if they're really small, like if length < 10), you might have to increase the constant ROUNDTO at the bottom
    '
    ' REFERENCES:
    ' {1} "The elastic rod" by M.E. Pacheco Q. & E. Pina, http://www.scielo.org.mx/pdf/rmfe/v53n2/v53n2a8.pdf
    ' {2} "An experiment in nonlinear beam theory" by A. Valiente, http://www.deepdyve.com/lp/doc/I3lwnxdfGz , also here: http://tiny.cc/Valiente_AEiNBT
    ' {3} "Snap buckling, writhing and Loop formation In twisted rods" by V.G.A. GOSS, http://myweb.lsbu.ac.uk/~gossga/thesisFinal.pdf
    ' {4} "Theory of Elastic Stability" by Stephen Timoshenko, http://www.scribd.com/doc/50402462/Timoshenko-Theory-of-Elastic-Stability  (start on p. 76)
    '
    ' INPUT:
    ' PtA - First anchor point (required)
    ' PtB - Second anchor point (optional, though 2 out of the 4--length, width, height, angle--need to be specified)
    '       [note that PtB can be the same as PtA (meaning width would be zero)]
    '       [also note that if a different width is additionally specified that's not equal to the distance between PtA and PtB, then the end point will not equal PtB anymore]
    ' Pln - Plane of the bent rod/wire, which bends up in the +y direction. The line between PtA and PtB (if specified) must be parallel to the x-axis of this plane
    '
    ' ** 2 of the following 4 need to be specified **
    ' Len - Length of the rod/wire, which needs to be > 0
    ' Wid - Width between the endpoints of the curve [note: if PtB is specified in addition, and distance between PtA and PtB <> width, the end point will be relocated
    ' Ht - Height of the bent rod/wire (when negative, curve will bend downward, relative to the input plane, instead)
    ' Ang - Inner departure angle or tangent angle (in radians) at the ends of the bent rod/wire. Set up so as width approaches length (thus height approaches zero), angle approaches zero
    '
    ' * Following variables only needed for optional calculating of bending force, not for shape of curve.
    ' E - Young's modulus (modulus of elasticity) in GPa (=N/m^2) (material-specific. for example, 7075 aluminum is roughly 71.7 GPa)
    ' I - Second moment of area (or area moment of inertia) in m^4 (cross-section-specific. for example, a hollow rod
    '     would have I = pi * (outer_diameter^4 - inner_diameter^4) / 32
    ' Note: E*I is also known as flexural rigidity or bending stiffness
    '
    ' OUTPUT:
    ' out - only for debugging messages
    ' Pts - the list of points that approximate the shape of the elastica
    ' Crv - the 3rd-degree curve interpolated from those points (with accurate start & end tangents)
    ' L - the length of the rod/wire
    ' W - the distance (width) between the endpoints of the rod/wire
    ' H - the height of the bent rod/wire
    ' A - the tangent angle at the (start) end of the rod/wire
    ' F - the force needed to hold the rod/wire in a specific shape (based on the material properties & cross-section) **be sure your units for 'I' match your units for the
    ' rest of your inputs (length, width, etc.). Also note that the critical buckling load (force) that makes the rod/wire start to bend can be found at height=0
    '
    ' THANKS TO:
    ' Mårten Nettelbladt (thegeometryofbending.blogspot.com)
    ' Daniel Piker (Kangaroo plugin)
    ' David Rutten (Grasshopper guru)
    ' Euler & Bernoulli (the O.G.'s)
    '
    ' -----------------------------------------------------------------

    Dim ignoreSelfIntersecting As Boolean = False  ' set to True if you don't want to output curves where width < 0, which creates a self-intersecting curve

    Dim inCt As Integer = 0  ' count the number of required parameters that are receiving data
    Dim length As Double
    Dim width As System.Object = Nothing  ' need to set as Nothing so we can check if it has been assigned a value later
    Dim height As Double
    Dim angle As Double
    Dim m As Double
    Dim multiple_m As New List(Of Double)
    Dim AtoB As Line
    Dim flip_H As Boolean = False  ' if height is negative, this flag will be set
    Dim flip_A As Boolean = False  ' if angle is negative, this flag will be set

    If Not IsSet("Pln") Then
      Msg("error", "Base plane is not set")
      Return
    End If

    If Not IsSet("PtA") Then
      Msg("error", "Point A is not set")
      Return
    End If

    If Math.Round(Pln.DistanceTo(PtA), Defined.ROUNDTO) <> 0 Then
      Msg("error", "Point A is not on the base plane")
      Return
    End If

    Dim refPlane As Plane = Pln  ' create a reference plane = input plane and set the origin of it to PtA in case PtA isn't the origin already
    refPlane.Origin = PtA

    If IsSet("PtB") Then
      If Math.Round(Pln.DistanceTo(PtB), Defined.ROUNDTO) <> 0 Then
        Msg("error", "Point B is not on the base plane")
        Return
      End If

      AtoB = New Line(PtA, PtB)
      If AtoB.Length <> 0 And Not AtoB.Direction.IsPerpendicularTo(Pln.YAxis) Then
        Msg("error", "The line between PtA and PtB is not perpendicular to the Y-axis of the specified plane")
        Return
      End If

      inCt += 1
      If IsSet("Wid") Then Msg("info", "Wid will override the distance between PtA and PtB. If you do not want this to happen, disconnect PtB or Wid.")

      width = PtA.DistanceTo(PtB)  ' get the width (distance) between PtA and PtB
      
      Dim refPtB As Point3d
      refPlane.RemapToPlaneSpace(PtB, refPtB)
      If refPtB.X < 0 Then width = -width  ' check if PtB is to the left of PtA...if so, width is negative
    End If

    If IsSet("Len") Then inCt += 1
    If IsSet("Wid") Then inCt += 1
    If IsSet("Ht") Then inCt += 1
    If IsSet("Ang") Then inCt += 1
    If inCt > 2 Then Msg("info", "More parameters set than are required (out of length, width, height, angle). Only using the first two valid ones.")

    ' check for connected/specified inputs. note: only the first two that it comes across will be used
    If IsSet("Len") Then  ' if length is specified then...
      If Len <= 0 Then
        Msg("error", "Length cannot be negative or zero")
        Return
      End If
      If IsSet("Wid") Then  ' find height & angle based on length and specified width
        If Wid > Len Then
          Msg("error", "Width is greater than length")
          Return
        End If
        If Wid = Len Then  ' skip the solver and set the known values
          height = 0
          m = 0
          angle = 0
          width = Wid
        Else
          m = SolveMFromLenWid(Len, Wid)
          height = Cal_H(Len, m)  ' L * Sqrt(m) / K(m)
          angle = Cal_A(m)  ' Acos(1 - 2 * m)
          width = Wid
        End If

      Else If width IsNot Nothing Then  ' find height & angle based on length and calculated width (distance between PtA and PtB)
        If width > Len Then
          Msg("error", "Width is greater than length")
          Return
        End If
        If width = Len Then  ' skip the solver and set the known values
          height = 0
          m = 0
          angle = 0
        Else
          m = SolveMFromLenWid(Len, width)
          height = Cal_H(Len, m)  ' L * Sqrt(m) / K(m)
          angle = Cal_A(m)  ' Acos(1 - 2 * m)
        End If

      Else If IsSet("Ht") Then  ' find width & angle based on length and height  ** possible to return 2 results **
        If Math.Abs(Ht / Len) > Defined.MAX_HL_RATIO Then
          Msg("error", "Height not possible with given length")
          Return
        End If
        If Ht < 0 Then
          Ht = -Ht  ' if height is negative, set it to positive (for the calculations) but flip the reference plane about its x-axis
          refPlane.Transform(Transform.Mirror(New Plane(refPlane.Origin, refPlane.XAxis, refPlane.ZAxis)))
          flip_A = True
          flip_H = True
        End If
        If Ht = 0 Then  ' skip the solver and set the known values
          width = Len
          angle = 0
        Else
          multiple_m = SolveMFromLenHt(Len, Ht)  ' note that it's possible for two values of m to be found if height is close to max height
          If multiple_m.Count = 1 Then  ' if there's only one m value returned, calculate the width & angle here. we'll deal with multiple m values later
            m = multiple_m.Item(0)
            width = Cal_W(Len, m)  ' L * (2 * E(m) / K(m) - 1)
            angle = Cal_A(m)  ' Acos(1 - 2 * m)
          End If
        End If
        height = Ht

      Else If IsSet("Ang") Then  ' find width & height based on length and angle
        If Ang < 0 Then
          Ang = -Ang  ' if angle is negative, set it to positive (for the calculations) but flip the reference plane about its x-axis
          refPlane.Transform(Transform.Mirror(New Plane(refPlane.Origin, refPlane.XAxis, refPlane.ZAxis)))
          flip_A = True
          flip_H = True
        End If
        m = Cal_M(Ang)  ' (1 - Cos(a)) / 2
        If Ang = 0 Then  ' skip the solver and set the known values
          width = Len
          height = 0
        Else
          width = Cal_W(Len, m)  ' L * (2 * E(m) / K(m) - 1)
          height = Cal_H(Len, m)  ' L * Sqrt(m) / K(m)
        End If
        angle = Ang

      Else
        Msg("error", "Need to specify one more parameter in addition to length")
        Return
      End If
      length = Len

    Else If IsSet("Wid") Then  ' if width is specified then...
      If IsSet("Ht") Then  ' find length & angle based on specified width and height
        If Ht < 0 Then
          Ht = -Ht  ' if height is negative, set it to positive (for the calculations) but flip the reference plane about its x-axis
          refPlane.Transform(Transform.Mirror(New Plane(refPlane.Origin, refPlane.XAxis, refPlane.ZAxis)))
          flip_A = True
          flip_H = True
        End If
        If Ht = 0 Then  ' skip the solver and set the known values
          length = Wid
          angle = 0
        Else
          m = SolveMFromWidHt(Wid, Ht)
          length = Cal_L(Ht, m)  ' h * K(m) / Sqrt(m)
          angle = Cal_A(m)  ' Acos(1 - 2 * m)
        End If
        height = Ht

      Else If IsSet("Ang") Then  ' find length & height based on specified width and angle
        If Wid = 0 Then
          Msg("error", "Curve not possible with width = 0 and an angle as inputs")
          Return
        End If
        If Ang < 0 Then
          Ang = -Ang  ' if angle is negative, set it to positive (for the calculations) but flip the reference plane about its x-axis
          refPlane.Transform(Transform.Mirror(New Plane(refPlane.Origin, refPlane.XAxis, refPlane.ZAxis)))
          flip_A = True
          flip_H = True
        End If
        m = Cal_M(Ang)  ' (1 - Cos(a)) / 2
        If Ang = 0 Then  ' skip the solver and set the known values
          length = Wid
          height = 0
        Else
          length = Wid / (2 * EllipticE(m) / EllipticK(m) - 1)
          If length < 0 Then
            Msg("error", "Curve not possible at specified width and angle (calculated length is negative)")
            Return
          End If
          height = Cal_H(length, m)  ' L * Sqrt(m) / K(m)
        End If
        angle = Ang

      Else
        Msg("error", "Need to specify one more parameter in addition to width (Wid)")
        Return
      End If
      width = Wid

    Else If width IsNot Nothing Then  ' if width is determined by PtA and PtB then...
      If IsSet("Ht") Then  ' find length & angle based on calculated width and height
        If Ht < 0 Then
          Ht = -Ht  ' if height is negative, set it to positive (for the calculations) but flip the reference plane about its x-axis
          refPlane.Transform(Transform.Mirror(New Plane(refPlane.Origin, refPlane.XAxis, refPlane.ZAxis)))
          flip_A = True
          flip_H = True
        End If
        If Ht = 0 Then  ' skip the solver and set the known values
          length = width
          angle = 0
        Else
          m = SolveMFromWidHt(width, Ht)
          length = Cal_L(Ht, m)  ' h * K(m) / Sqrt(m)
          angle = Cal_A(m)  ' Acos(1 - 2 * m)
        End If
        height = Ht

      Else If IsSet("Ang") Then  ' find length & height based on calculated width and angle
        If width = 0 Then
          Msg("error", "Curve not possible with width = 0 and an angle as inputs")
          Return
        End If
        If Ang < 0 Then
          Ang = -Ang  ' if angle is negative, set it to positive (for the calculations) but flip the reference plane about its x-axis
          refPlane.Transform(Transform.Mirror(New Plane(refPlane.Origin, refPlane.XAxis, refPlane.ZAxis)))
          flip_A = True
          flip_H = True
        End If
        m = Cal_M(Ang)  ' (1 - Cos(a)) / 2
        If Ang = 0 Then  ' skip the solver and set the known values
          length = width
          height = 0
        Else
          length = width / (2 * EllipticE(m) / EllipticK(m) - 1)
          If length < 0 Then
            Msg("error", "Curve not possible at specified width and angle (calculated length is negative)")
            Return
          End If
          height = Cal_H(length, m)  ' L * Sqrt(m) / K(m)
        End If
        angle = Ang

      Else
        Msg("error", "Need to specify one more parameter in addition to PtA and PtB")
        Return
      End If

    Else If IsSet("Ht") Then  ' if height is specified then...
      If IsSet("Ang") Then  ' find length & width based on height and angle
        If Ht < 0 Then
          Ht = -Ht  ' if height is negative, set it to positive (for the calculations) but flip the reference plane about its x-axis
          refPlane.Transform(Transform.Mirror(New Plane(refPlane.Origin, refPlane.XAxis, refPlane.ZAxis)))
          flip_H = True
          flip_A = True
        End If
        If Ht = 0 Then
          Msg("error", "Height can't = 0 if only height and angle are specified")
          Return
        Else
          If Ang < 0 Then
            Ang = -Ang  ' if angle is negative, set it to positive (for the calculations) but flip the reference plane about its x-axis
            refPlane.Transform(Transform.Mirror(New Plane(refPlane.Origin, refPlane.XAxis, refPlane.ZAxis)))
            flip_A = Not flip_A
            flip_H = Not flip_H
          End If
          m = Cal_M(Ang)  ' (1 - Cos(a)) / 2
          If Ang = 0 Then
            Msg("error", "Angle can't = 0 if only height and angle are specified")
            Return
          Else
            length = Cal_L(Ht, m)  ' h * K(m) / Sqrt(m)
            width = Cal_W(length, m)  ' L * (2 * E(m) / K(m) - 1)
          End If
          angle = Ang
        End If
        height = Ht

      Else
        Msg("error", "Need to specify one more parameter in addition to height")
        Return
      End If

    Else If IsSet("Ang") Then
      Msg("error", "Need to specify one more parameter in addition to angle")
      Return
    Else
      Msg("error", "Need to specify two of the four parameters: length, width (or PtB), height, and angle")
      Return
    End If

    If m > Defined.M_MAX Then
      Msg("error", "Form of curve not solvable with current algorithm and given inputs")
      Return
    End If

    refPlane.Origin = refPlane.PointAt(width / 2, 0, 0)  ' adjust the origin of the reference plane so that the curve is centered about the y-axis (start of the curve is at x = -width/2)

    If multiple_m.Count > 1 Then  ' if there is more than one m value returned, calculate the width, angle, and curve for each
      Dim multi_pts As New DataTree(Of Point3d)
      Dim multi_crv As New List(Of Curve)
      Dim tmp_pts As New List(Of Point3d)
      Dim multi_W, multi_A, multi_F As New List(Of Double)
      Dim j As Integer = 0  ' used for creating a new branch (GH_Path) for storing pts which is itself a list of points

      For Each m_val As Double In multiple_m
        width = Cal_W(length, m_val) 'length * (2 * EllipticE(m_val) / EllipticK(m_val) - 1)
        
        If width < 0 And ignoreSelfIntersecting Then
          Msg("warning", "One curve is self-intersecting. To enable these, set ignoreSelfIntersecting to False")
          Continue For
        End If
        
        If m_val >= Defined.M_SKETCHY Then Msg("info", "Accuracy of the curve whose width = " & Math.Round(width, 4) & " is not guaranteed")
        
        angle = Cal_A(m_val) 'Math.Asin(2 * m_val - 1)
        refPlane.Origin = refPlane.PointAt(width / 2, 0, 0)  ' adjust the origin of the reference plane so that the curve is centered about the y-axis (start of the curve is at x = -width/2)
        
        tmp_pts = FindBendForm(length, width, m_val, angle, refPlane)
        multi_pts.AddRange(tmp_pts, New GH_Path(j))
        multi_crv.Add(MakeCurve(tmp_pts, angle, refPlane))
        
        multi_W.Add(width)
        If flip_A Then angle = -angle
        multi_A.Add(angle)
        
        E = E * 10 ^ 9  ' Young's modulus input E is in GPa, so we convert to Pa here (= N/m^2)
        multi_F.Add(EllipticK(m_val) ^ 2 * E * I / length ^ 2)  ' from reference {4} pg. 79
        
        j += 1
        refPlane.Origin = PtA  ' reset the reference plane origin to PtA for the next m_val
        'Print("length=" & length & ", width=" & width & ", height=" & height & ", angle=" & angle & ", m=" & m_val & ", k=" & Math.Sqrt(m_val) & ", w/L=" & width / length & ", h/L=" & height / length & ", w/h=" & width / height)
      Next

      ' assign the outputs
      Pts = multi_pts
      Crv = multi_crv
      L = length
      W = multi_W
      If flip_H Then height = -height
      H = height
      A = multi_A
      F = multi_F

    Else  ' only deal with the single m value
      If m >= Defined.M_SKETCHY Then Msg("info", "Accuracy of the curve at these parameters is not guaranteed")
      
      If width < 0 And ignoreSelfIntersecting Then
        Msg("error", "Curve is self-intersecting. To enable these, set ignoreSelfIntersecting to False")
        Return
      End If
      
      Pts = FindBendForm(length, width, m, angle, refPlane)
      Crv = MakeCurve(pts, angle, refPlane)
      L = length
      W = width
      If flip_H Then height = -height
      H = height
      If flip_A Then angle = -angle
      A = angle

      E = E * 10 ^ 9  ' Young's modulus input E is in GPa, so we convert to Pa here (= N/m^2)
      F = EllipticK(m) ^ 2 * E * I / length ^ 2  ' from reference {4} pg. 79. Note: the critical buckling (that makes the rod/wire start to bend) can be found at height=0 (width=length)

      'height = Math.Sqrt(((2 * Len / 5) ^ 2 - ((Wid - Len / 5) / 2) ^ 2)  ' quick approximation discovered by Mårten of 'Geometry of Bending' fame ( http://tiny.cc/it2pbx )
      'width = (Len +/- 2 * Math.Sqrt(4 * Len ^ 2 - 25 * Ht ^ 2)) / 5  ' derived from above
      'length = (2 * Math.Sqrt(15 * Ht ^ 2 + 4 * Wid ^ 2) - Wid) / 3  ' derived from above

      'Print("length=" & length & ", width=" & width & ", height=" & height & ", angle=" & angle & ", m=" & m & ", k=" & Math.Sqrt(m) & ", w/L=" & width / length & ", h/L=" & height / length & ", w/h=" & width / height)
    End If
# ---------- vb: VB additional code ----------
  Private Function IsSet(ByVal param As String) As Boolean  ' Check if an input parameter has data
    Dim i As Integer = Component.Params.IndexOfInputParam(param)
    If i > -1 Then
      Return Component.Params.Input.ElementAt(i).DataType > 1  ' input parameter DataType of 1 means it's not receiving input (internal or external)
    Else
      Msg("error", "Input parameter '" & param & "' not found")
      Return False
    End If
  End Function

  Private Sub Msg(ByVal type As String, ByVal msg As String)  ' Output an error, warning, or informational message
    Select Case type
      Case "error"
        Component.AddRuntimeMessage(GH_RuntimeMessageLevel.Error, msg)
        Print("Error: " & msg)
      Case "warning"
        Component.AddRuntimeMessage(GH_RuntimeMessageLevel.Warning, msg)
        Print("Warning: " & msg)
      Case "info"
        Component.AddRuntimeMessage(GH_RuntimeMessageLevel.Remark, msg)
        Print(msg)
    End Select
  End Sub

  ' Solve for the m parameter from length and width (reference {1} equation (34), except b = width and K(k) and E(k) should be K(m) and E(m))
  Private Function SolveMFromLenWid(ByVal L As Double, ByVal w As Double) As Double
    If w = 0 Then
      Return Defined.M_ZERO_W  ' for the boundry condition width = 0, bypass the function and return the known m value
    End If

    Dim n As Integer = 1 ' Iteration counter (quit if >MAXIT)
    Dim lower As Double = 0 ' m must be within this range
    Dim upper As Double = 1
    Dim m As Double
    Dim cwl As Double

    Do While (upper - lower) > Defined.MAXERR AndAlso (n) < Defined.MAXIT ' Repeat until range narrow enough or MAXIT
      m = (upper + lower) / 2
      cwl = 2 * EllipticE(m) / EllipticK(m) - 1  ' calculate w/L with the test value of m
      If cwl < w / L Then  ' compares the calculated w/L with the actual w/L then narrows the range of possible m
        upper = m
      Else
        lower = m
      End If
      n += 1
    Loop
    Return m
  End Function

  ' Solve for the m parameter from length and height (reference {1} equation (33), except K(k) should be K(m) and k = sqrt(m))
  ' Note that it's actually possible to find 2 valid values for m (hence 2 width values) at certain height values
  Private Function SolveMFromLenHt(ByVal L As Double, ByVal h As Double) As List(Of Double)
    Dim n As Integer = 1 ' Iteration counter (quit if >MAXIT)
    Dim lower As Double = 0 ' m must be within this range
    Dim upper As Double = 1
    Dim twoWidths As Boolean = h / L >= Defined.DOUBLE_W_HL_RATIO And h / L < Defined.MAX_HL_RATIO  ' check to see if h/L is within the range where 2 solutions for the width are possible
    Dim m As Double
    Dim mult_m As New List(Of Double)
    Dim chl As Double

    If twoWidths Then
      ' find the first of two possible solutions for m with the following limits:
      lower = Defined.M_DOUBLE_W  ' see constants at bottom of script
      upper = Defined.M_MAXHEIGHT  ' see constants at bottom of script
      Do While (upper - lower) > Defined.MAXERR AndAlso (n) < Defined.MAXIT ' Repeat until range narrow enough or MAXIT
        m = (upper + lower) / 2
        chl = Math.Sqrt(m) / EllipticK(m)  ' calculate h/L with the test value of m
        If chl > h / L Then  ' compares the calculated h/L with the actual h/L then narrows the range of possible m
          upper = m
        Else
          lower = m
        End If
        n += 1
      Loop
      mult_m.Add(m)

      ' then find the second of two possible solutions for m with the following limits:
      lower = Defined.M_MAXHEIGHT  ' see constants at bottom of script
      upper = 1
      Do While (upper - lower) > Defined.MAXERR AndAlso (n) < Defined.MAXIT ' Repeat until range narrow enough or MAXIT
        m = (upper + lower) / 2
        chl = Math.Sqrt(m) / EllipticK(m)  ' calculate h/L with the test value of m
        If chl < h / L Then  ' compares the calculated h/L with the actual h/L then narrows the range of possible m
          upper = m
        Else
          lower = m
        End If
        n += 1
      Loop

      If m <= Defined.M_MAX Then  ' return this m parameter only if it falls within the maximum useful value (above which the curve breaks down)
        mult_m.Add(m)
      End If

    Else
      ' find the one possible solution for the m parameter
      upper = Defined.M_DOUBLE_W  ' limit the upper end of the search to the maximum value of m for which only one solution exists
      Do While (upper - lower) > Defined.MAXERR AndAlso (n) < Defined.MAXIT ' Repeat until range narrow enough or MAXIT
        m = (upper + lower) / 2
        chl = Math.Sqrt(m) / EllipticK(m)  ' calculate h/L with the test value of m
        If chl > h / L Then  ' compares the calculated h/L with the actual h/L then narrows the range of possible m
          upper = m
        Else
          lower = m
        End If
        n += 1
      Loop
      mult_m.Add(m)
    End If

    Return mult_m
  End Function

  ' Solve for the m parameter from width and height (derived from reference {1} equations (33) and (34) with same notes as above)
  Private Function SolveMFromWidHt(ByVal w As Double, ByVal h As Double) As Double
    Dim n As Integer = 1 ' Iteration counter (quit if >MAXIT)
    Dim lower As Double = 0 ' m must be within this range
    Dim upper As Double = 1
    Dim m As Double
    Dim cwh As Double

    Do While (upper - lower) > Defined.MAXERR AndAlso (n) < Defined.MAXIT ' Repeat until range narrow enough or MAXIT
      m = (upper + lower) / 2
      cwh = (2 * EllipticE(m) - EllipticK(m)) / Math.Sqrt(m)  ' calculate w/h with the test value of m
      If cwh < w / h Then  ' compares the calculated w/h with the actual w/h then narrows the range of possible m
        upper = m
      Else
        lower = m
      End If
      n += 1
    Loop

    Return m
  End Function

  ' Calculate length based on height and an m parameter, derived from reference {1} equation (33), except K(k) should be K(m) and k = sqrt(m)
  Private Function Cal_L(ByVal h As Double, ByVal m As Double) As Double
    Return h * EllipticK(m) / Math.Sqrt(m)
  End Function

  ' Calculate width based on length and an m parameter, derived from reference {1} equation (34), except b = width and K(k) and E(k) should be K(m) and E(m)
  Private Function Cal_W(ByVal L As Double, ByVal m As Double) As Double
    Return L * (2 * EllipticE(m) / EllipticK(m) - 1)
  End Function

  ' Calculate height based on length and an m parameter, from reference {1} equation (33), except K(k) should be K(m) and k = sqrt(m)
  Private Function Cal_H(ByVal L As Double, ByVal m As Double) As Double
    Return L * Math.Sqrt(m) / EllipticK(m)
  End Function

  ' Calculate the unique m parameter based on a start tangent angle, from reference {2}, just above equation (9a), that states k = Sin(angle / 2 + Pi / 4),
  ' but as m = k^2 and due to this script's need for an angle rotated 90° versus the one in reference {1}, the following formula is the result
  ' New note: verified by reference {4}, pg. 78 at the bottom
  Private Function Cal_M(ByVal a As Double) As Double
    Return (1 - Math.Cos(a)) / 2  ' equal to Sin^2(a/2) too
  End Function

  ' Calculate start tangent angle based on an m parameter, derived from above formula
  Private Function Cal_A(ByVal m As Double) As Double
    Return Math.Acos(1 - 2 * m)
  End Function

  ' This is the heart of this script, taking the found (or specified) length, width, and angle values along with the found m parameter to create
  ' a list of points that approximate the shape or form of the elastica. It works by finding the x and y coordinates (which are reversed versus
  ' the original equations (12a) and (12b) from reference {2} due to the 90° difference in orientation) based on the tangent angle along the curve.
  ' See reference {2} for more details on how they derived it. Note that to simplify things, the algorithm only calculates the points for half of the
  ' curve, then mirrors those points along the y-axis.
  Private Function FindBendForm(ByVal L As Double, ByVal w As Double, ByVal m As Double, ByVal ang As Double, ByVal refPln As Plane) As List(Of Point3d)
    L = L / 2  ' because the below algorithm is based on the formulas in reference {2} for only half of the curve
    w = w / 2  ' same

    If ang = 0 Then  ' if angle (and height) = 0, then simply return the start and end points of the straight line
      Dim out As New List(Of Point3d)
      out.Add(refPln.PointAt(w, 0, 0))
      out.Add(refPln.PointAt(-w, 0, 0))
      Return out
    End If

    Dim x As Double
    Dim y As Double
    Dim halfCurvePts As New List(Of Point3d)
    Dim fullCurvePts As New List(Of Point3d)
    Dim translatedPts As New List(Of Point3d)

    ang -= Math.PI / 2  ' a hack to allow this algorithm to work, since the original curve in paper {2} was rotated 90°
    Dim angB As Double = ang + (-Math.PI / 2 - ang) / Defined.CURVEDIVS  ' angB is the 'lowercase theta' which should be in formula {2}(12b) as the interval
    ' start [a typo...see equation(3)]. It's necessary to start angB at ang + [interval] instead of just ang due to integration failing at angB = ang
    halfCurvePts.Add(New Point3d(w, 0, 0))  ' start with this known initial point, as integration will fail when angB = ang

    ' each point {x, y} is calculated from the tangent angle, angB, that occurs at each point (which is why this iterates from ~ang to -pi/2, the known end condition)
    Do While Math.Round(angB, Defined.ROUNDTO) >= Math.Round(-Math.PI / 2, Defined.ROUNDTO)
      y = (Math.Sqrt(2) * Math.Sqrt(Math.Sin(ang) - Math.Sin(angB)) * (w + L)) / (2 * EllipticE(m))  ' note that x and y are swapped vs. (12a) and (12b)
      x = (L / (Math.Sqrt(2) * EllipticK(m))) * Simpson(angB, -Math.PI / 2, 500, ang)  ' calculate the Simpson approximation of the integral (function f below)
      ' over the interval angB ('lowercase theta') to -pi/2. side note: is 500 too few iterations for the Simson algorithm?

      If Math.Round(x, Defined.ROUNDTO) = 0 Then x = 0
      halfCurvePts.Add(New Point3d(x, y, 0))

      angB += (-Math.PI / 2 - ang) / Defined.CURVEDIVS  ' onto the next tangent angle
    Loop

    ' After finding the x and y values for half of the curve, add the {-x, y} values for the rest of the curve
    For Each point As Point3d In halfCurvePts
      If Math.Round(point.X, Defined.ROUNDTO) = 0 Then
        If Math.Round(point.Y, Defined.ROUNDTO) = 0 Then
          fullCurvePts.Add(New Point3d(0, 0, 0))  ' special case when width = 0: when x = 0, only duplicate the point when y = 0 too
        End If
      Else
        fullCurvePts.Add(New Point3d(-point.X, point.Y, 0))
      End If
    Next
    halfCurvePts.Reverse
    fullCurvePts.AddRange(halfCurvePts)

    For Each p As Point3d In fullCurvePts
      translatedPts.Add(refPln.PointAt(p.X, p.Y, p.Z))  ' translate the points from the reference plane to the world plane
    Next

    Return translatedPts
  End Function

  ' Interpolates the points from FindBendForm to create the Elastica curve. Uses start & end tangents for greater accuracy.
  Private Function MakeCurve(ByVal pts As List(Of Point3d), ByVal ang As Double, ByVal refPln As Plane) As Curve
    If ang <> 0 Then
      Dim ts, te As New Vector3d(refPln.XAxis)
      ts.Rotate(ang, refPln.ZAxis)
      te.Rotate(-ang, refPln.ZAxis)
      Return Curve.CreateInterpolatedCurve(pts, 3, CurveKnotStyle.Chord, ts, te)  ' 3rd degree curve with 'Chord' Knot Style
    Else
      Return Curve.CreateInterpolatedCurve(pts, 3)  ' if angle (and height) = 0, then simply interpolate the straight line (no start/end tangents)
    End If
  End Function

  ' Implements the Simpson approximation for an integral of function f below
  Public Function Simpson(a As Double, b As Double, n As Integer, theta As Double) As Double 'n should be an even number
    Dim j As Integer, s1 As Double, s2 As Double, h As Double
    h = (b - a) / n
    s1 = 0
    s2 = 0
    For j = 1 To n - 1 Step 2
      s1 = s1 + fn(a + j * h, theta)
    Next j
    For j = 2 To n - 2 Step 2
      s2 = s2 + fn(a + j * h, theta)
    Next j
    Simpson = h / 3 * (fn(a, theta) + 4 * s1 + 2 * s2 + fn(b, theta))
  End Function

  ' Specific calculation for the above integration
  Public Function fn(x As Double, theta As Double) As Double
    fn = Math.Sin(x) / (Math.Sqrt(Math.Sin(theta) - Math.Sin(x)))  ' from reference {2} formula (12b)
  End Function


  ' Return the Complete Elliptic integral of the 1st kind
  ' Abramowitz and Stegun p.591, formula 17.3.11
  ' Code from http://www.codeproject.com/Articles/566614/Elliptic-integrals
  Public Function EllipticK(ByVal m As Double) As Double
    Dim sum, term, above, below As Double
    sum = 1
    term = 1
    above = 1
    below = 2

    For i As Integer = 1 To 100
      term *= above / below
      sum += Math.Pow(m, i) * Math.Pow(term, 2)
      above += 2
      below += 2
    Next
    sum *= 0.5 * Math.PI
    Return sum
  End Function


  ' Return the Complete Elliptic integral of the 2nd kind
  ' Abramowitz and Stegun p.591, formula 17.3.12
  ' Code from http://www.codeproject.com/Articles/566614/Elliptic-integrals
  Public Function EllipticE(ByVal m As Double) As Double
    Dim sum, term, above, below As Double
    sum = 1
    term = 1
    above = 1
    below = 2

    For i As Integer = 1 To 100
      term *= above / below
      sum -= Math.Pow(m, i) * Math.Pow(term, 2) / above
      above += 2
      below += 2
    Next
    sum *= 0.5 * Math.PI
    Return sum
  End Function

  Friend Partial NotInheritable Class Defined
    Private Sub New()
    End Sub

    ' Note: most of these values for m and h/L ratio were found with Wolfram Alpha and either specific intercepts (x=0) or local minima/maxima. They should be constant.
    Public Const M_SKETCHY As Double = 0.95  ' value of the m parameter where the curvature near the ends of the curve gets wonky
    Public Const M_MAX As Double = 0.993  ' maximum useful value of the m parameter, above which this algorithm for the form of the curve breaks down
    Public Const M_ZERO_W As Double = 0.826114765984970336  ' value of the m parameter when width = 0
    Public Const M_MAXHEIGHT As Double = 0.701327460663101223  ' value of the m parameter at maximum possible height of the bent rod/wire
    Public Const M_DOUBLE_W As Double = 0.180254422335013983  ' minimum value of the m parameter when two width values are possible for a given height and length
    Public Const DOUBLE_W_HL_RATIO As Double = 0.257342117984635757  ' value of the height/length ratio above which there are two possible width values
    Public Const MAX_HL_RATIO As Double = 0.403140189705650243  ' maximum possible value of the height/length ratio

    Public Const MAXERR As Double = 0.0000000001  ' error tolerance
    Public Const MAXIT As Integer = 100  ' maximum number of iterations
    Public Const ROUNDTO As Integer = 10  ' number of decimal places to round off to
    Public Const CURVEDIVS As Integer = 50  ' number of sample points for building the curve (or half-curve as it were)
  End Class
# ---------- end vb ----------
panel_2 = Panel(vb.H)
panel_3 = Panel(vb.L)
deg = Degrees(Radians=vb.A)
pt_3 = Point(vb.Pts)
crv = Curve(vb.Crv)
panel_4 = Panel(deg)
panel_5 = Panel(vb.W)

# ----
subtraction_2 = Subtraction(A=subtraction, B=distance_between_arcs)
subtraction_3 = Subtraction(A=subtraction_2, B=distance_between_arcs)
addition = Addition(A=subtraction_3, B=number_slider)
panel_6 = Panel(subtraction_3)

# ---- group: Ideal curve (6.5m rod)
angle_2 = Slider(110.7, range=0..170)
height_2 = Slider(112.83, range=0..200)
width_2 = Slider(183.21, range=-130..400)
pt_4 = ConstructPoint(XCoordinate=subtraction, YCoordinate=0, ZCoordinate=0)
rad_2 = Radians(Degrees=angle_2)

width_3 = Slider(183.21, range=-130..400)
height_3 = Slider(112.83, range=0..200)
angle_3 = Slider(110.7, range=0..170)
pt_5 = ConstructPoint(XCoordinate=subtraction_2, YCoordinate=0, ZCoordinate=0)
rad_3 = Radians(Degrees=angle_3)

width_4 = Slider(183.21, range=-130..400)
height_4 = Slider(112.83, range=0..200)
angle_4 = Slider(110.7, range=0..170)
pt_6 = ConstructPoint(XCoordinate=subtraction_3, YCoordinate=0, ZCoordinate=0)
rad_4 = Radians(Degrees=angle_4)

neg_2 = Negative(Value=subtraction)
neg_3 = Negative(Value=subtraction_2)
neg_4 = Negative(Value=subtraction_3)
subtraction_4 = Subtraction(A=vb.H, B=distance_between_arcs)
panel_7 = Panel(subtraction_4)
curvepoint = PointOnCurve(crv, parameter=0.5)

pt_7 = ConstructPoint(XCoordinate=neg_2, YCoordinate=0, ZCoordinate=0)
vb_2 = VBScript(PtA=pt_7, PtB=pt_4, Pln=xz_2, Ht=subtraction_4)  # -> out, Pts, Crv, L, W, H, A, F; inputs PtA: Point3d, PtB: Point3d, Pln: Plane; same code as vb
panel_8 = Panel(vb_2.L)
panel_9 = Panel(vb_2.H)
panel_10 = Panel(vb_2.W)

# ----
addition_2 = Addition(A=neg_4, B=number_slider)
crv_2 = Curve(vb_2.Crv)
subcrv = SubCurve(BaseCurve=reparameterize(crv_2), Domain=dom)
crv_3 = Curve(subcrv)
end = EndPoints(Curve=crv_3)  # -> Start, End

# ---- group: Ideal curve (6.5m rod) (continued)
pt_8 = ConstructPoint(XCoordinate=neg_3, YCoordinate=0, ZCoordinate=0)

subtraction_5 = Subtraction(A=vb_2.H, B=distance_between_arcs)
panel_11 = Panel(subtraction_5)

vb_3 = VBScript(PtA=pt_8, PtB=pt_5, Pln=xz_3, Ht=subtraction_5)  # -> out, Pts, Crv, L, W, H, A, F; inputs PtA: Point3d, PtB: Point3d, Pln: Plane; same code as vb
panel_12 = Panel(vb_3.H)
panel_13 = Panel(vb_3.L)
deg_2 = Degrees(Radians=vb_3.A)
crv_4 = Curve(vb_3.Crv)
panel_14 = Panel(deg_2)
panel_15 = Panel(vb_3.W)

# ---- group: slit geometry for weaving and cloth simulation
number_slider_5 = Slider(0.333, range=0.333..0.667)
number_slider_6 = Slider(0.667, range=0.333..0.667)
dom_2 = ConstructDomain(DomainStart=number_slider_5, DomainEnd=number_slider_6)
subcrv_2 = SubCurve(BaseCurve=reparameterize(crv_2), Domain=dom_2)
dom_3 = ConstructDomain(DomainStart=Slider(0.333, range=0.333..0.667), DomainEnd=Slider(0.667, range=0.333..0.667))
subcrv_3 = SubCurve(BaseCurve=reparameterize(crv_4), Domain=dom_3)
crv_5 = Curve(subcrv_2)
crv_6 = Curve(subcrv_3)
end_2 = EndPoints(Curve=crv_5)  # -> Start, End
end_3 = EndPoints(Curve=crv_6)  # -> Start, End
curvepoint_2 = PointOnCurve(crv_5, parameter=0.5)
ln = Line(StartPoint=end_2.Start, EndPoint=end_3.Start)
ln_2 = Line(StartPoint=end_2.End, EndPoint=end_3.End)
merge = Merge(Data1=crv_5, Data2=subcrv_3, Data3=ln, Data4=ln_2)
rulesrf = RuledSurface(CurveA=crv_5, CurveB=crv_6)

# ----
dom_4 = ConstructDomain(DomainStart=number_slider_5, DomainEnd=number_slider_6)
subcrv_4 = SubCurve(BaseCurve=reparameterize(crv), Domain=dom_4)
crv_7 = Curve(subcrv_4)
curvepoint_3 = PointOnCurve(crv_7, parameter=0.5)
end_4 = EndPoints(Curve=crv_7)  # -> Start, End
merge_2 = Merge(Data1=crv_7, Data2=subcrv)
rulesrf_2 = RuledSurface(CurveA=crv_7, CurveB=crv_3)

# ---- group: slit geometry for weaving and cloth simulation / slits
panel_16 = Panel("""13
5
5
5
5
5
5
5
5
5
5
5
5
5""")
pdecon = Deconstruct(Point=curvepoint_3)  # -> XComponent, YComponent, ZComponent
panel_17 = Panel(pdecon.ZComponent)
ma = MassAddition(Input=panel_16)  # -> Result, PartialResults
subtraction_6 = Subtraction(A=pdecon.ZComponent, B=ma.PartialResults)
panel_18 = Panel("""0
4.5
3
9
3
9
3
9
3
9
3
9
3
9
3
9""")
dispatch = Dispatch(List=subtraction_6, DispatchPattern=[True, False])  # -> ListA, ListB
graft = GraftTree(Tree=dispatch.ListA, IncludeEmptyLists=True, IncludeNullItems=True)
graft_2 = GraftTree(Tree=dispatch.ListB, IncludeEmptyLists=True, IncludeNullItems=True)
panel_19 = Panel("""1.5
9
3
9
3
9
3
9
3
9
3
9
3
9
3""")
ma_2 = MassAddition(Input=panel_18)  # -> Result, PartialResults
pt_9 = ConstructPoint(XCoordinate=ma_2.PartialResults, YCoordinate=0, ZCoordinate=graft)
pline = PolyLine(Vertices=pt_9, Closed=False)
ma_3 = MassAddition(Input=panel_19)  # -> Result, PartialResults
pt_10 = ConstructPoint(XCoordinate=ma_3.PartialResults, YCoordinate=0, ZCoordinate=graft_2)
pline_2 = PolyLine(Vertices=pt_10, Closed=False)
explode = Explode(Curve=pline_2, Recursive=True)  # -> Segments, Vertices
explode_2 = Explode(Curve=pline, Recursive=True)  # -> Segments, Vertices
dispatch_2 = Dispatch(List=explode.Segments, DispatchPattern=[True, False])  # -> ListA, ListB
dispatch_3 = Dispatch(List=explode_2.Segments, DispatchPattern=[True, False])  # -> ListA, ListB
line = Line(dispatch_2.ListA)
line_2 = Line(dispatch_3.ListA)

# ---- group: slit geometry for weaving and cloth simulation
neg_5 = Negative(Value=panel_18)
ma_4 = MassAddition(Input=neg_5)  # -> Result, PartialResults
pt_11 = ConstructPoint(XCoordinate=ma_4.PartialResults, YCoordinate=0, ZCoordinate=graft)
neg_6 = Negative(Value=panel_19)
pline_3 = PolyLine(Vertices=pt_11, Closed=False)
ma_5 = MassAddition(Input=neg_6)  # -> Result, PartialResults
pt_12 = ConstructPoint(XCoordinate=ma_5.PartialResults, YCoordinate=0, ZCoordinate=graft_2)
pline_4 = PolyLine(Vertices=pt_12, Closed=False)
explode_3 = Explode(Curve=pline_4, Recursive=True)  # -> Segments, Vertices
explode_4 = Explode(Curve=pline_3, Recursive=True)  # -> Segments, Vertices
dispatch_4 = Dispatch(List=explode_3.Segments, DispatchPattern=[True, False])  # -> ListA, ListB
dispatch_5 = Dispatch(List=explode_4.Segments, DispatchPattern=[True, False])  # -> ListA, ListB
line_3 = Line(dispatch_4.ListA)
line_4 = Line(dispatch_5.ListA)
xz_5 = XZPlane(Origin=Point(0, 0, 0))
offcrv = OffsetCurve(Curve=[line_2, line, line_4, line_3], Plane=xz_5, Distance=Slider(0.01, range=0..0.1), BothSides=0, Kinks=0, CapType=1)
flatten = FlattenTree(Tree=offcrv, Path="{0}")
srfsplit = SurfaceSplit(Surface=rulesrf, Curves=flatten)
item = ListItem(List=srfsplit, Index=Slider(87, range=0..100), Wrap=True)

# ----
srfsplit_2 = SurfaceSplit(Surface=rulesrf_2, Curves=flatten)
item_2 = ListItem(List=srfsplit_2, Index=Slider(92, range=0..100), Wrap=True)
area = Area(Geometry=srfsplit_2)  # -> Area, Centroid
panel_20 = Panel(area.Area)

# ---- group: Ideal curve (6.5m rod) (continued)
pt_13 = ConstructPoint(XCoordinate=neg_4, YCoordinate=0, ZCoordinate=0)

# ----
panel_21 = Panel(pt_13)

# ---- group: Ideal curve (6.5m rod) (continued)
subtraction_7 = Subtraction(A=vb_3.H, B=distance_between_arcs)
panel_22 = Panel(subtraction_7)

vb_4 = VBScript(PtA=pt_13, PtB=pt_6, Pln=xz_4, Ht=subtraction_7)  # -> out, Pts, Crv, L, W, H, A, F; inputs PtA: Point3d, PtB: Point3d, Pln: Plane; same code as vb
panel_23 = Panel(vb_4.H)
panel_24 = Panel(vb_4.L)
deg_3 = Degrees(Radians=vb_4.A)
pt_14 = Point(vb_4.Pts)
crv_8 = Curve(vb_4.Crv)
panel_25 = Panel(vb_4.W)
panel_26 = Panel(deg_3)

curvepoint_4 = PointOnCurve(crv_8, parameter=0.5)

# ---- group: adding lines for weaving layer logic
rod = Slider(1.6, range=0..10)
cut_seam = Slider(2, range=0..10)
_1_compound = Slider(1, range=0..10)
neg_7 = Negative(Value=cut_seam)
neg_8 = Negative(Value=_1_compound)
neg_9 = Negative(Value=rod)
offset = OffsetCurve(Curve=crv, Distance=neg_8, Corners=1)
offset_2 = OffsetCurve(Curve=crv_4, Distance=neg_7, Corners=1)
offset_3 = OffsetCurve(Curve=offset, Distance=neg_9, Corners=1)
offset_4 = OffsetCurve(Curve=offset_2, Distance=neg_8, Corners=1)
offset_5 = OffsetCurve(Curve=offset_3, Distance=neg_8, Corners=1)
offset_6 = OffsetCurve(Curve=offset_4, Distance=neg_7, Corners=1)
offset_7 = OffsetCurve(Curve=offset_5, Distance=neg_7, Corners=1)
offset_8 = OffsetCurve(Curve=offset_6, Distance=neg_9, Corners=1)
offset_9 = OffsetCurve(Curve=offset_7, Distance=neg_9, Corners=1)
offset_10 = OffsetCurve(Curve=crv_2, Distance=neg_7, Corners=1)
neg_10 = Negative(Value=Slider(2, range=0..10))
offset_11 = OffsetCurve(Curve=offset_10, Distance=neg_8, Corners=1)
offset_12 = OffsetCurve(Curve=crv_8, Distance=neg_10, Corners=1)
offset_13 = OffsetCurve(Curve=offset_11, Distance=neg_7, Corners=1)
offset_14 = OffsetCurve(Curve=offset_13, Distance=neg_9, Corners=1)

# ----
merge_3 = Merge(
    Data1=crv_8,
    Data2=crv_4,
    Data3=crv_8,
    Data4=crv_4,
    Data5=crv_2,
    Data6=crv_4,
    Data7=crv_2,
    Data8=crv,
    Data9=crv_2,
    Data10=crv)
curvepoint_5 = PointOnCurve(merge_3, parameter=0.5)
curvepoint_6 = PointOnCurve(merge_3, parameter=0.75)
curvepoint_7 = PointOnCurve(merge_3, parameter=0)
curvepoint_8 = PointOnCurve(merge_3, parameter=0.25)
curvepoint_9 = PointOnCurve(merge_3, parameter=1)

# ---- group: Lifting geometry
number_slider_7 = Slider(30, range=0..1000)
number_slider_8 = Slider(200, range=0..10000)
py3 = Python3Script(points=curvepoint_9, y_lift=number_slider_8, min_angle=number_slider_7)  # -> out, a; inputs points: list of Point3d
# ---------- py3: Python ----------
import Rhino.Geometry as rg
import math

# ---------------------------------------------------
# INPUTS
# ---------------------------------------------------

pts = [rg.Point3d(p) for p in points]
lift = y_lift

max_angle = math.radians(min_angle)

# ---------------------------------------------------
# DIST + INITIAL SEGMENT DATA
# ---------------------------------------------------

def dist(a, b):
    return a.DistanceTo(b)

segs = []
orig_dirs = []

for i in range(len(pts) - 1):
    seg_len = dist(pts[i], pts[i + 1])
    segs.append(seg_len)

    d = pts[i + 1] - pts[i]
    if not d.IsTiny():
        d.Unitize()
    orig_dirs.append(d)

# ---------------------------------------------------
# CONE CLAMP
# ---------------------------------------------------

def clamp_vector_to_cone(vec, axis, max_angle):

    v = rg.Vector3d(vec)
    a = rg.Vector3d(axis)

    if v.IsTiny():
        return a

    v.Unitize()
    a.Unitize()

    angle = rg.Vector3d.VectorAngle(a, v)

    # already inside cone
    if angle <= max_angle:
        return v

    rot_axis = rg.Vector3d.CrossProduct(a, v)

    if rot_axis.IsTiny():
        return a

    rot_axis.Unitize()

    constrained = rg.Vector3d(a)

    rot = rg.Transform.Rotation(
        max_angle,
        rot_axis,
        rg.Point3d.Origin
    )

    constrained.Transform(rot)
    constrained.Unitize()

    return constrained

# ---------------------------------------------------
# END PIN
# ---------------------------------------------------

end = rg.Point3d(pts[-1])

# ---------------------------------------------------
# FABRIK LOOP
# ---------------------------------------------------

for _ in range(200):

    # ------------------------------------------------
    # HARD CONSTRAINTS (IMPORTANT)
    # ------------------------------------------------

    pts[0] = rg.Point3d(pts[0].X, lift, pts[0].Z)
    pts[-1] = end

    # =================================================
    # FORWARD PASS
    # =================================================

    for i in range(1, len(pts) - 1):  # ❗ FIXED: exclude last point

        parent = pts[i - 1]
        current = pts[i]

        vec = current - parent

        if vec.IsTiny():
            continue

        vec.Unitize()

        # dynamic stability: blend original + current direction
        axis = rg.Vector3d(orig_dirs[i - 1])

        vec = clamp_vector_to_cone(vec, axis, max_angle)

        pts[i] = parent + vec * segs[i - 1]

        # floor constraint
        if pts[i].Y < 0:
            pts[i] = rg.Point3d(pts[i].X, 0, pts[i].Z)

    # =================================================
    # BACKWARD PASS
    # =================================================

    pts[-1] = end  # re-pin before solving backward

    for i in range(len(pts) - 2, 0, -1):

        child = pts[i + 1]
        current = pts[i]

        vec = current - child

        if vec.IsTiny():
            continue

        vec.Unitize()

        axis = -rg.Vector3d(orig_dirs[i])

        vec = clamp_vector_to_cone(vec, axis, max_angle)

        pts[i] = child + vec * segs[i]

        # floor constraint
        if pts[i].Y < 0:
            pts[i] = rg.Point3d(pts[i].X, 0, pts[i].Z)

    # final reinforcement (prevents drift accumulation)
    pts[-1] = end

# ---------------------------------------------------
# OUTPUT
# ---------------------------------------------------

a = pts
# ---------- end py3 ----------
py3_2 = Python3Script(points=curvepoint_6, y_lift=number_slider_8, min_angle=number_slider_7)  # -> out, a; inputs points: list of Point3d; same code as py3
py3_3 = Python3Script(points=curvepoint_5, y_lift=number_slider_8, min_angle=number_slider_7)  # -> out, a; inputs points: list of Point3d; same code as py3
py3_4 = Python3Script(points=curvepoint_7, y_lift=number_slider_8, min_angle=number_slider_7)  # -> out, a; inputs points: list of Point3d; same code as py3
py3_5 = Python3Script(points=curvepoint_8, y_lift=number_slider_8, min_angle=number_slider_7)  # -> out, a; inputs points: list of Point3d; same code as py3
graft_3 = GraftTree(Tree=py3_2.a, IncludeEmptyLists=True, IncludeNullItems=True)
graft_4 = GraftTree(Tree=py3_5.a, IncludeEmptyLists=True, IncludeNullItems=True)
graft_5 = GraftTree(Tree=py3.a, IncludeEmptyLists=True, IncludeNullItems=True)
graft_6 = GraftTree(Tree=py3_3.a, IncludeEmptyLists=True, IncludeNullItems=True)
graft_7 = GraftTree(Tree=py3_4.a, IncludeEmptyLists=True, IncludeNullItems=True)
panel_27 = Panel(graft_7)
merge_4 = Merge(Data1=graft_7, Data2=graft_4, Data3=graft_6, Data4=graft_3, Data5=graft_5)
intcrv = Interpolate(Vertices=merge_4, Degree=Slider(11, range=0..100), Periodic=False, KnotStyle=1)  # -> Curve, Length, Domain

# ----
merge_5 = Merge(
    Data1=offset,
    Data2=offset_3,
    Data3=offset_5,
    Data4=offset_7,
    Data5=offset_9,
    Data6=offset_10,
    Data7=offset_11,
    Data8=offset_13,
    Data9=offset_14,
    Data10=offset_2,
    Data11=offset_4,
    Data12=offset_6,
    Data13=offset_8,
    Data14=offset_12)

# ---- group: Farbic geometry
flatten_2 = FlattenTree(Tree=intcrv.Curve, Path="{0}")
panel_28 = Panel(flatten_2)
split = SplitList(List=flatten_2, Index=Slider(1, range=0..10))  # -> ListA, ListB
lng = ListLength(List=split.ListB)
item_3 = ListItem(List=split.ListB, Index=lng, Wrap=True)
loft = Loft(Curves=split.ListB, Options={Adjust=False, Closed=False, LoftEnds=0, LoftSimp=0, LoftType=0, Rebuild=10, Refit=0.01})
end_5 = EndPoints(Curve=item_3)  # -> Start, End
dispatch_6 = Dispatch(List=split.ListB, DispatchPattern=[True, False])  # -> ListA, ListB
ln_3 = Line(StartPoint=end_5.Start, EndPoint=end_5.End)
panel_29 = Panel(dispatch_6.ListA)
loft_opt = LoftOptions(Closed=False, Adjust=False, Rebuild=0, Refit=0, Type=Slider(3, range=0..10))
loftex = LoftEx(Curves=split.ListB, Options=loft_opt)
edgesrf = EdgeSurface(CurveA=item_3, CurveB=ln_3)
panel_30 = Panel(dispatch_6.ListB)

# ---- group: Diagonals
crv_9 = Curve(split.ListB)
item_4 = ListItem(List=crv_9, Index=Slider(6, range=0..10), Wrap=True)
item_5 = ListItem(List=crv_9, Index=Slider(3, range=0..10), Wrap=True)
item_6 = ListItem(List=crv_9, Index=Slider(0, range=0..100), Wrap=True)
curvepoint_10 = PointOnCurve(item_5, parameter=0.667)
curvepoint_11 = PointOnCurve(item_4, parameter=0)
curvepoint_12 = PointOnCurve(item_4, parameter=1)
item_7 = ListItem(List=crv_9, Index=Slider(8, range=0..10), Wrap=True)
curvepoint_13 = PointOnCurve(item_4, parameter=0.333)
curvepoint_14 = PointOnCurve(item_5, parameter=0.333)
curvepoint_15 = PointOnCurve(item_4, parameter=0.667)
curvepoint_16 = PointOnCurve(item_6, parameter=0.333)
curvepoint_17 = PointOnCurve(item_5, parameter=0)
curvepoint_18 = PointOnCurve(item_7, parameter=1)
curvepoint_19 = PointOnCurve(item_6, parameter=0.667)
curvepoint_20 = PointOnCurve(item_5, parameter=1)
curvepoint_21 = PointOnCurve(item_7, parameter=0)
pdecon_2 = Deconstruct(Point=curvepoint_14)  # -> XComponent, YComponent, ZComponent
pdecon_3 = Deconstruct(Point=curvepoint_11)  # -> XComponent, YComponent, ZComponent
pdecon_4 = Deconstruct(Point=curvepoint_12)  # -> XComponent, YComponent, ZComponent
pdecon_5 = Deconstruct(Point=curvepoint_13)  # -> XComponent, YComponent, ZComponent
pdecon_6 = Deconstruct(Point=curvepoint_10)  # -> XComponent, YComponent, ZComponent
pdecon_7 = Deconstruct(Point=curvepoint_15)  # -> XComponent, YComponent, ZComponent
pdecon_8 = Deconstruct(Point=curvepoint_21)  # -> XComponent, YComponent, ZComponent
pdecon_9 = Deconstruct(Point=curvepoint_18)  # -> XComponent, YComponent, ZComponent
pdecon_10 = Deconstruct(Point=curvepoint_16)  # -> XComponent, YComponent, ZComponent
pdecon_11 = Deconstruct(Point=curvepoint_17)  # -> XComponent, YComponent, ZComponent
pdecon_12 = Deconstruct(Point=curvepoint_19)  # -> XComponent, YComponent, ZComponent
pdecon_13 = Deconstruct(Point=curvepoint_20)  # -> XComponent, YComponent, ZComponent
pt_15 = ConstructPoint(XCoordinate=pdecon_2.XComponent, YCoordinate=pdecon_3.YComponent, ZCoordinate=pdecon_3.ZComponent)
pt_16 = ConstructPoint(XCoordinate=pdecon_8.XComponent, YCoordinate=pdecon_5.YComponent, ZCoordinate=pdecon_5.ZComponent)
pt_17 = ConstructPoint(XCoordinate=pdecon_4.XComponent, YCoordinate=pdecon_6.YComponent, ZCoordinate=pdecon_6.ZComponent)
pt_18 = ConstructPoint(XCoordinate=pdecon_9.XComponent, YCoordinate=pdecon_7.YComponent, ZCoordinate=pdecon_7.ZComponent)
pt_19 = ConstructPoint(XCoordinate=pdecon_10.XComponent, YCoordinate=pdecon_11.YComponent, ZCoordinate=pdecon_11.ZComponent)
number_slider_9 = Slider(5, range=0..100)
pt_20 = ConstructPoint(XCoordinate=pdecon_12.XComponent, YCoordinate=pdecon_13.YComponent, ZCoordinate=pdecon_13.ZComponent)
pl_3pt = Plane3Pt(PointA=curvepoint_11, PointB=curvepoint_14, PointC=pt_15)
pl_3pt_2 = Plane3Pt(PointA=curvepoint_17, PointB=curvepoint_16, PointC=pt_19)
pl_3pt_3 = Plane3Pt(PointA=curvepoint_20, PointB=curvepoint_19, PointC=pt_20)
number_slider_10 = Slider(0, range=0..10)
pl_3pt_4 = Plane3Pt(PointA=curvepoint_13, PointB=curvepoint_21, PointC=pt_16)
number_slider_11 = Slider(4, range=0..10)
pl_3pt_5 = Plane3Pt(PointA=curvepoint_12, PointB=curvepoint_10, PointC=pt_17)
pl_3pt_6 = Plane3Pt(PointA=curvepoint_18, PointB=curvepoint_15, PointC=pt_18)
vb_5 = VBScript(PtA=curvepoint_20, PtB=curvepoint_19, Pln=pl_3pt_3, Ht=number_slider_9)  # -> out, Pts, Crv, L, W, H, A, F; inputs PtA: Point3d, PtB: Point3d, Pln: Plane; same code as vb
vb_6 = VBScript(PtA=curvepoint_17, PtB=curvepoint_16, Pln=pl_3pt_2, Ht=number_slider_9)  # -> out, Pts, Crv, L, W, H, A, F; inputs PtA: Point3d, PtB: Point3d, Pln: Plane; same code as vb
neg_11 = Negative(Value=number_slider_11)
vb_7 = VBScript(PtA=curvepoint_12, PtB=curvepoint_10, Pln=pl_3pt_5, Ht=neg_11)  # -> out, Pts, Crv, L, W, H, A, F; inputs PtA: Point3d, PtB: Point3d, Pln: Plane; same code as vb
panel_31 = Panel(vb_5.L)
vb_8 = VBScript(PtA=curvepoint_11, PtB=curvepoint_14, Pln=pl_3pt, Ht=number_slider_11)  # -> out, Pts, Crv, L, W, H, A, F; inputs PtA: Point3d, PtB: Point3d, Pln: Plane; same code as vb
vb_9 = VBScript(PtA=curvepoint_13, PtB=curvepoint_21, Pln=pl_3pt_4, Ht=number_slider_10)  # -> out, Pts, Crv, L, W, H, A, F; inputs PtA: Point3d, PtB: Point3d, Pln: Plane; same code as vb
vb_10 = VBScript(PtA=curvepoint_18, PtB=curvepoint_15, Pln=pl_3pt_6, Ht=number_slider_10)  # -> out, Pts, Crv, L, W, H, A, F; inputs PtA: Point3d, PtB: Point3d, Pln: Plane; same code as vb
panel_32 = Panel(vb_6.L)
panel_33 = Panel(vb_8.L)
panel_34 = Panel(vb_9.L)

# ---- group: Seams
flatten_3 = FlattenTree(Tree=intcrv.Curve, Path="{0}")
seam = Seam(L=flatten_3, i=Slider(1, range=0..10), D=Slider(-2.45, range=-10..0))  # -> L_3, i_2, C, L_2
seam_2 = Seam(L=flatten_3, i=Slider(9, range=0..10), D=Slider(-2.45, range=-10..0))  # -> L_3, i_2, C, L_2
seam_3 = Seam(L=flatten_3, i=Slider(4, range=0..10), D=Slider(-2.45, range=-10..0))  # -> L_3, i_2, C, L_2
seam_4 = Seam(L=flatten_3, i=Slider(7, range=0..10), D=Slider(-2.45, range=-10..0))  # -> L_3, i_2, C, L_2
edgesrf_2 = EdgeSurface(CurveA=seam.L_3, CurveB=seam.L_2, CurveC=seam.C, CurveD=seam.i_2)
edgesrf_3 = EdgeSurface(CurveA=seam_2.L_3, CurveB=seam_2.L_2, CurveC=seam_2.C, CurveD=seam_2.i_2)
edgesrf_4 = EdgeSurface(CurveA=seam_3.L_3, CurveB=seam_3.L_2, CurveC=seam_3.C, CurveD=seam_3.i_2)
edgesrf_5 = EdgeSurface(CurveA=seam_4.L_3, CurveB=seam_4.L_2, CurveC=seam_4.C, CurveD=seam_4.i_2)

# ---- group: Guy cables
crv_10 = Curve(split.ListB)
item_8 = ListItem(List=crv_10, Index=Slider(2, range=0..10), Wrap=True)
item_9 = ListItem(List=crv_10, Index=Slider(0, range=0..100), Wrap=True)
item_10 = ListItem(List=crv_10, Index=Slider(8, range=0..10), Wrap=True)
item_11 = ListItem(List=crv_10, Index=Slider(6, range=0..10), Wrap=True)
curvepoint_22 = PointOnCurve(item_11, parameter=1)
curvepoint_23 = PointOnCurve(item_9, parameter=0.667)
curvepoint_24 = PointOnCurve(item_9, parameter=0.333)
curvepoint_25 = PointOnCurve(item_11, parameter=0)
curvepoint_26 = PointOnCurve(item_8, parameter=1)
curvepoint_27 = PointOnCurve(item_10, parameter=0.667)
curvepoint_28 = PointOnCurve(item_10, parameter=0.333)
curvepoint_29 = PointOnCurve(item_8, parameter=0)
ln_4 = Line(StartPoint=curvepoint_23, EndPoint=curvepoint_22)
ln_5 = Line(StartPoint=curvepoint_24, EndPoint=curvepoint_25)
ln_6 = Line(StartPoint=curvepoint_27, EndPoint=curvepoint_26)
number_slider_12 = Slider(-20, range=-100..0)
ln_7 = Line(StartPoint=curvepoint_28, EndPoint=curvepoint_29)
number_slider_13 = Slider(20, range=0..100)
devec = DeconstructVector(Vector=ln_4)  # -> XComponent, YComponent, ZComponent
devec_2 = DeconstructVector(Vector=ln_7)  # -> XComponent, YComponent, ZComponent
devec_3 = DeconstructVector(Vector=ln_5)  # -> XComponent, YComponent, ZComponent
devec_4 = DeconstructVector(Vector=ln_6)  # -> XComponent, YComponent, ZComponent
neg_12 = Negative(Value=number_slider_13)
neg_13 = Negative(Value=devec.YComponent)
neg_14 = Negative(Value=devec_4.YComponent)
neg_15 = Negative(Value=devec_3.YComponent)
neg_16 = Negative(Value=devec_2.YComponent)
addition_3 = Addition(A=neg_14, B=neg_12)
addition_4 = Addition(A=devec_2.XComponent, B=number_slider_12)
vec = VectorXYZ(XComponent=devec.XComponent, YComponent=neg_13, ZComponent=devec.ZComponent)  # -> Vector, Length
addition_5 = Addition(A=devec_4.XComponent, B=number_slider_13)
addition_6 = Addition(A=neg_16, B=number_slider_12)
vec_2 = VectorXYZ(XComponent=devec_3.XComponent, YComponent=neg_15, ZComponent=devec_3.ZComponent)  # -> Vector, Length
vec_3 = VectorXYZ(XComponent=addition_5, YComponent=addition_3, ZComponent=devec_4.ZComponent)  # -> Vector, Length
vec_4 = VectorXYZ(XComponent=addition_4, YComponent=addition_6, ZComponent=devec_2.ZComponent)  # -> Vector, Length
line_5 = LineSDL(Start=curvepoint_23, Direction=vec.Vector, Length=vec.Length)
line_6 = LineSDL(Start=curvepoint_24, Direction=vec_2.Vector, Length=vec_2.Length)
line_7 = LineSDL(Start=curvepoint_27, Direction=vec_3.Vector, Length=vec_3.Length)
line_8 = LineSDL(Start=curvepoint_28, Direction=vec_4.Vector, Length=vec_4.Length)
pipe = Pipe(Curve=[line_7, line_8, line_5, line_6], Radius=Slider(0.2, range=0..1), Caps=0)

# ---- group: Membranes
crv_11 = Curve(split.ListB)
crv_12 = Curve(split.ListB)
item_12 = ListItem(List=crv_12, Index=Slider(6, range=0..10), Wrap=True)
item_13 = ListItem(List=crv_12, Index=Slider(5, range=0..10), Wrap=True)
item_14 = ListItem(List=crv_12, Index=Slider(3, range=0..100), Wrap=True)
item_15 = ListItem(List=crv_11, Index=Slider(3, range=0..10), Wrap=True)
item_16 = ListItem(List=crv_11, Index=Slider(2, range=0..10), Wrap=True)
item_17 = ListItem(List=crv_11, Index=Slider(0, range=0..100), Wrap=True)
curvepoint_30 = PointOnCurve(item_17, parameter=0.5)
curvepoint_31 = PointOnCurve(item_14, parameter=0.5)
dom_5 = ConstructDomain(DomainStart=Slider(0.333, range=0.333..0.667), DomainEnd=Slider(0.667, range=0.333..0.667))
subcrv_5 = SubCurve(BaseCurve=reparameterize(item_15), Domain=dom_5)
curvepoint_32 = PointOnCurve(subcrv_5, parameter=0.5)
subcrv_6 = SubCurve(BaseCurve=reparameterize(item_16), Domain=dom_5)
curvepoint_33 = PointOnCurve(subcrv_6, parameter=0.5)
ln_8 = Line(StartPoint=curvepoint_32, EndPoint=curvepoint_30)
dom_6 = ConstructDomain(DomainStart=Slider(0.333, range=0.333..0.667), DomainEnd=Slider(0.667, range=0.333..0.667))
subcrv_7 = SubCurve(BaseCurve=reparameterize(item_12), Domain=dom_6)
curvepoint_34 = PointOnCurve(subcrv_7, parameter=0.5)
subcrv_8 = SubCurve(BaseCurve=reparameterize(item_13), Domain=dom_6)
curvepoint_35 = PointOnCurve(subcrv_8, parameter=0.5)
ln_9 = Line(StartPoint=curvepoint_34, EndPoint=curvepoint_31)
crv_cp = CurveClosestPoint(Point=curvepoint_33, Curve=ln_8)  # -> Point, Parameter, Distance
crv_cp_2 = CurveClosestPoint(Point=curvepoint_35, Curve=ln_9)  # -> Point, Parameter, Distance
vec2pt = Vector2Pt(PointA=curvepoint_33, PointB=crv_cp.Point, Unitize=False)  # -> Vector, Length
move = Move(Geometry=subcrv_6, Motion=vec2pt.Vector)  # -> Geometry, Transform
vec2pt_2 = Vector2Pt(PointA=curvepoint_35, PointB=crv_cp_2.Point, Unitize=False)  # -> Vector, Length
move_2 = Move(Geometry=subcrv_8, Motion=vec2pt_2.Vector)  # -> Geometry, Transform
end_6 = EndPoints(Curve=subcrv_5)  # -> Start, End
end_7 = EndPoints(Curve=subcrv_7)  # -> Start, End
end_8 = EndPoints(Curve=move.Geometry)  # -> Start, End
crv_cp_3 = CurveClosestPoint(Point=end_8.End, Curve=item_17)  # -> Point, Parameter, Distance
crv_cp_4 = CurveClosestPoint(Point=end_8.Start, Curve=item_17)  # -> Point, Parameter, Distance
end_9 = EndPoints(Curve=move_2.Geometry)  # -> Start, End
crv_cp_5 = CurveClosestPoint(Point=end_9.End, Curve=item_14)  # -> Point, Parameter, Distance
crv_cp_6 = CurveClosestPoint(Point=end_9.Start, Curve=item_14)  # -> Point, Parameter, Distance
ln_10 = Line(StartPoint=end_6.Start, EndPoint=end_8.Start)
ln_11 = Line(StartPoint=end_7.End, EndPoint=end_9.End)
ln_12 = Line(StartPoint=crv_cp.Point, EndPoint=curvepoint_30)
ln_13 = Line(StartPoint=end_7.Start, EndPoint=end_9.Start)
ln_14 = Line(StartPoint=end_8.End, EndPoint=crv_cp_3.Point)
ln_15 = Line(StartPoint=end_6.End, EndPoint=end_8.End)
ln_16 = Line(StartPoint=end_8.Start, EndPoint=crv_cp_4.Point)
ln_17 = Line(StartPoint=end_9.Start, EndPoint=crv_cp_6.Point)
ln_18 = Line(StartPoint=end_9.End, EndPoint=crv_cp_5.Point)
ln_19 = Line(StartPoint=crv_cp_2.Point, EndPoint=curvepoint_31)
rulesrf_3 = RuledSurface(CurveA=subcrv_5, CurveB=move.Geometry)
rulesrf_4 = RuledSurface(CurveA=subcrv_7, CurveB=move_2.Geometry)
pipe_2 = Pipe(Curve=[ln_16, ln_14, ln_12], Radius=Slider(0.1, range=0..0.1), Caps=0)
pipe_3 = Pipe(Curve=[ln_17, ln_18, ln_19], Radius=Slider(0.1, range=0..0.1), Caps=0)

# ---- group: inner seams
seam_5 = Seam(L=flatten_3, i=Slider(2, range=0..10), D=Slider(2.45, range=0..10))  # -> L_3, i_2, C, L_2
seam_6 = Seam(L=flatten_3, i=Slider(5, range=0..10), D=Slider(2.45, range=0..10))  # -> L_3, i_2, C, L_2
seam_7 = Seam(L=flatten_3, i=Slider(8, range=0..10), D=Slider(2.45, range=0..10))  # -> L_3, i_2, C, L_2
edgesrf_6 = EdgeSurface(CurveA=seam_5.L_3, CurveB=seam_5.i_2, CurveC=seam_5.C, CurveD=seam_5.L_2)
edgesrf_7 = EdgeSurface(CurveA=seam_6.L_3, CurveB=seam_6.i_2, CurveC=seam_6.C, CurveD=seam_6.L_2)
edgesrf_8 = EdgeSurface(CurveA=seam_7.L_3, CurveB=seam_7.i_2, CurveC=seam_7.C, CurveD=seam_7.L_2)

# ----
item_18 = ListItem(List=flatten_2, Index=Slider(1, range=0..10), Wrap=True)
curvepoint_36 = PointOnCurve(item_18, parameter=0.5)
pdecon_14 = Deconstruct(Point=curvepoint_36)  # -> XComponent, YComponent, ZComponent
panel_35 = Panel(pdecon_14.ZComponent)

# ---- group: floor straps
flatten_4 = FlattenTree(Tree=intcrv.Curve, Path="{0}")
item_19 = ListItem(List=flatten_4, Index=Slider(1, range=0..1), Wrap=True)
item_20 = ListItem(List=flatten_4, Index=Slider(4, range=0..10), Wrap=True)
item_21 = ListItem(List=flatten_4, Index=Slider(9, range=0..10), Wrap=True)
item_22 = ListItem(List=flatten_4, Index=Slider(7, range=0..10), Wrap=True)
end_10 = EndPoints(Curve=item_19)  # -> Start, End
end_11 = EndPoints(Curve=item_20)  # -> Start, End
end_12 = EndPoints(Curve=item_21)  # -> Start, End
end_13 = EndPoints(Curve=item_22)  # -> Start, End
ln_20 = Line(StartPoint=end_10.Start, EndPoint=end_10.End)
ln_21 = Line(StartPoint=end_11.Start, EndPoint=end_11.End)
ln_22 = Line(StartPoint=end_12.Start, EndPoint=end_12.End)
ln_23 = Line(StartPoint=end_13.Start, EndPoint=end_13.End)
number_slider_14 = Slider(1, range=0..100)
neg_17 = Negative(Value=number_slider_14)
offcrv_2 = OffsetCurve(Curve=[ln_20, ln_21, ln_23, ln_22], Plane=PlaneXY(0, 0, 0), Distance=number_slider_14, BothSides=0, Kinks=0, CapType=1)
offcrv_3 = OffsetCurve(Curve=[ln_20, ln_21, ln_23, ln_22], Plane=PlaneXY(0, 0, 0), Distance=neg_17, BothSides=0, Kinks=0, CapType=1)
boundary = BoundarySurfaces(Edges=[offcrv_2, offcrv_3])
extr = Extrude(Base=boundary, Direction="{0,0,0.3}")

# ----
merge_6 = Merge(Data1=edgesrf_2, Data2=edgesrf_4, Data3=edgesrf_5, Data4=edgesrf_3, Data5=edgesrf_6, Data6=edgesrf_7, Data7=edgesrf_8)

# ---- group: Floor rods
number_slider_15 = Slider(4, range=0..100)
end_14 = EndPoints(Curve=item_6)  # -> Start, End
end_15 = EndPoints(Curve=item_5)  # -> Start, End
end_16 = EndPoints(Curve=item_4)  # -> Start, End
end_17 = EndPoints(Curve=item_7)  # -> Start, End
pdecon_15 = Deconstruct(Point=end_15.Start)  # -> XComponent, YComponent, ZComponent
pdecon_16 = Deconstruct(Point=end_14.Start)  # -> XComponent, YComponent, ZComponent
pdecon_17 = Deconstruct(Point=end_14.End)  # -> XComponent, YComponent, ZComponent
pdecon_18 = Deconstruct(Point=end_15.End)  # -> XComponent, YComponent, ZComponent
pdecon_19 = Deconstruct(Point=end_15.Start)  # -> XComponent, YComponent, ZComponent
pdecon_20 = Deconstruct(Point=end_16.Start)  # -> XComponent, YComponent, ZComponent
pt_21 = ConstructPoint(XCoordinate=pdecon_16.XComponent, YCoordinate=pdecon_15.YComponent, ZCoordinate=0)
pdecon_21 = Deconstruct(Point=end_16.End)  # -> XComponent, YComponent, ZComponent
pdecon_22 = Deconstruct(Point=end_17.Start)  # -> XComponent, YComponent, ZComponent
pdecon_23 = Deconstruct(Point=end_15.End)  # -> XComponent, YComponent, ZComponent
pdecon_24 = Deconstruct(Point=end_16.Start)  # -> XComponent, YComponent, ZComponent
pt_22 = ConstructPoint(XCoordinate=pdecon_17.XComponent, YCoordinate=pdecon_18.YComponent, ZCoordinate=0)
pt_23 = ConstructPoint(XCoordinate=pdecon_20.XComponent, YCoordinate=pdecon_19.YComponent, ZCoordinate=0)
pdecon_25 = Deconstruct(Point=end_17.End)  # -> XComponent, YComponent, ZComponent
pl_3pt_7 = Plane3Pt(PointA=end_14.Start, PointB=end_15.Start, PointC=pt_21)
pt_24 = ConstructPoint(XCoordinate=pdecon_24.XComponent, YCoordinate=pdecon_22.YComponent, ZCoordinate=0)
pt_25 = ConstructPoint(XCoordinate=pdecon_21.XComponent, YCoordinate=pdecon_23.YComponent, ZCoordinate=0)
pl_3pt_8 = Plane3Pt(PointA=end_14.End, PointB=end_15.End, PointC=pt_22)
pl_3pt_9 = Plane3Pt(PointA=end_16.Start, PointB=end_15.Start, PointC=pt_23)
pt_26 = ConstructPoint(XCoordinate=0, YCoordinate=pdecon_25.YComponent, ZCoordinate=0)
pl_3pt_10 = Plane3Pt(PointA=end_16.Start, PointB=end_17.Start, PointC=pt_24)
pl_3pt_11 = Plane3Pt(PointA=end_16.End, PointB=end_15.End, PointC=pt_25)
vb_11 = VBScript(PtA=end_14.Start, PtB=end_15.Start, Pln=pl_3pt_7, Ht=number_slider_15)  # -> out, Pts, Crv, L, W, H, A, F; inputs PtA: Point3d, PtB: Point3d, Pln: Plane; same code as vb
vb_12 = VBScript(PtA=end_14.End, PtB=end_15.End, Pln=pl_3pt_8, Ht=number_slider_15)  # -> out, Pts, Crv, L, W, H, A, F; inputs PtA: Point3d, PtB: Point3d, Pln: Plane; same code as vb
pl_3pt_12 = Plane3Pt(PointA=end_16.End, PointB=end_17.End, PointC=pt_26)
vb_13 = VBScript(PtA=end_16.End, PtB=end_15.End, Pln=pl_3pt_11, Ht=number_slider_15)  # -> out, Pts, Crv, L, W, H, A, F; inputs PtA: Point3d, PtB: Point3d, Pln: Plane; same code as vb
vb_14 = VBScript(PtA=end_16.Start, PtB=end_15.Start, Pln=pl_3pt_9, Ht=number_slider_15)  # -> out, Pts, Crv, L, W, H, A, F; inputs PtA: Point3d, PtB: Point3d, Pln: Plane; same code as vb
vb_15 = VBScript(PtA=end_16.Start, PtB=end_17.Start, Pln=pl_3pt_10, Ht=number_slider_15)  # -> out, Pts, Crv, L, W, H, A, F; inputs PtA: Point3d, PtB: Point3d, Pln: Plane; same code as vb
crv_13 = Curve(vb_11.Crv)
vb_16 = VBScript(PtA=end_16.End, PtB=end_17.End, Pln=pl_3pt_12, Ht=number_slider_15)  # -> out, Pts, Crv, L, W, H, A, F; inputs PtA: Point3d, PtB: Point3d, Pln: Plane; same code as vb
crv_14 = Curve(vb_12.Crv)
crv_15 = Curve(vb_14.Crv)
panel_36 = Panel(vb_12.L)
crv_16 = Curve(vb_13.Crv)
crv_17 = Curve(vb_15.Crv)
crv_18 = Curve(vb_16.Crv)
panel_37 = Panel(vb_13.L)
panel_38 = Panel(vb_16.L)

# ----
addition_7 = Addition(A=vb_12.L, B=vb_13.L, C=vb_16.L)

# ---- group: elongated state
curvepoint_37 = PointOnCurve(ln_19, parameter=0.5)
curvepoint_38 = PointOnCurve(ln_19, parameter=0)
vec2pt_3 = Vector2Pt(PointA=curvepoint_38, PointB=curvepoint_37, Unitize=False)  # -> Vector, Length
move_3 = Move(Geometry=move_2.Geometry, Motion=vec2pt_3.Vector)  # -> Geometry, Transform
curvepoint_39 = PointOnCurve(move_3.Geometry, parameter=0.5)
end_18 = EndPoints(Curve=move_3.Geometry)  # -> Start, End
rulesrf_5 = RuledSurface(CurveA=subcrv_7, CurveB=move_3.Geometry)
ln_24 = Line(StartPoint=end_18.Start, EndPoint=crv_cp_6.Point)
ln_25 = Line(StartPoint=end_18.End, EndPoint=crv_cp_5.Point)
ln_26 = Line(StartPoint=curvepoint_39, EndPoint=curvepoint_31)
crvcoilpts = CurveCoilPoints(
    Curve=ln_24,
    ParametersT=[0, 0.033333, 0.066667, 0.1, 0.133333, 0.166667, 0.2, 0.233333, 0.266667, 0.3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],
    Weighted=False,
    Offsets=Domain(0, 1),
    Rotations=[0, 50, 100, 150, 200, 250, 300, 350, 400, 450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])
crvcoilpts_2 = CurveCoilPoints(
    Curve=ln_25,
    ParametersT=[0, 0.033333, 0.066667, 0.1, 0.133333, 0.166667, 0.2, 0.233333, 0.266667, 0.3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],
    Weighted=False,
    Offsets=Domain(0, 1),
    Rotations=[0, 50, 100, 150, 200, 250, 300, 350, 400, 450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])
crvcoilpts_3 = CurveCoilPoints(
    Curve=ln_26,
    ParametersT=[0, 0.033333, 0.066667, 0.1, 0.133333, 0.166667, 0.2, 0.233333, 0.266667, 0.3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],
    Weighted=False,
    Offsets=Domain(0, 1),
    Rotations=[0, 50, 100, 150, 200, 250, 300, 350, 400, 450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])
intcrv_2 = Interpolate(Vertices=crvcoilpts, Degree=3, Periodic=False, KnotStyle=1)  # -> Curve, Length, Domain
intcrv_3 = Interpolate(Vertices=crvcoilpts_3, Degree=3, Periodic=False, KnotStyle=1)  # -> Curve, Length, Domain
intcrv_4 = Interpolate(Vertices=crvcoilpts_2, Degree=3, Periodic=False, KnotStyle=1)  # -> Curve, Length, Domain
contour = Contour(Shape=rulesrf_5, Point=Point(0, 0, 0), Direction="{0,1,0}", Distance=Slider(4, range=0..10))
pipe_4 = Pipe(Curve=[intcrv_2.Curve, intcrv_4.Curve, intcrv_3.Curve], Radius=Slider(0.25, range=0..1), Caps=0)

curvepoint_40 = PointOnCurve(ln_12, parameter=0.5)
curvepoint_41 = PointOnCurve(ln_12, parameter=0)
vec2pt_4 = Vector2Pt(PointA=curvepoint_41, PointB=curvepoint_40, Unitize=False)  # -> Vector, Length
move_4 = Move(Geometry=move.Geometry, Motion=vec2pt_4.Vector)  # -> Geometry, Transform
curvepoint_42 = PointOnCurve(move_4.Geometry, parameter=0.5)
end_19 = EndPoints(Curve=move_4.Geometry)  # -> Start, End
rulesrf_6 = RuledSurface(CurveA=subcrv_5, CurveB=move_4.Geometry)
ln_27 = Line(StartPoint=end_19.End, EndPoint=crv_cp_3.Point)
ln_28 = Line(StartPoint=curvepoint_42, EndPoint=curvepoint_30)
ln_29 = Line(StartPoint=end_19.Start, EndPoint=crv_cp_4.Point)
crvcoilpts_4 = CurveCoilPoints(
    Curve=ln_29,
    ParametersT=[0, 0.033333, 0.066667, 0.1, 0.133333, 0.166667, 0.2, 0.233333, 0.266667, 0.3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],
    Weighted=False,
    Offsets=Domain(0, 1),
    Rotations=[0, 50, 100, 150, 200, 250, 300, 350, 400, 450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])
crvcoilpts_5 = CurveCoilPoints(
    Curve=ln_27,
    ParametersT=[0, 0.033333, 0.066667, 0.1, 0.133333, 0.166667, 0.2, 0.233333, 0.266667, 0.3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],
    Weighted=False,
    Offsets=Domain(0, 1),
    Rotations=[0, 50, 100, 150, 200, 250, 300, 350, 400, 450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])
crvcoilpts_6 = CurveCoilPoints(
    Curve=ln_28,
    ParametersT=[0, 0.033333, 0.066667, 0.1, 0.133333, 0.166667, 0.2, 0.233333, 0.266667, 0.3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],
    Weighted=False,
    Offsets=Domain(0, 1),
    Rotations=[0, 50, 100, 150, 200, 250, 300, 350, 400, 450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])
intcrv_5 = Interpolate(Vertices=crvcoilpts_4, Degree=3, Periodic=False, KnotStyle=1)  # -> Curve, Length, Domain
intcrv_6 = Interpolate(Vertices=crvcoilpts_6, Degree=3, Periodic=False, KnotStyle=1)  # -> Curve, Length, Domain
intcrv_7 = Interpolate(Vertices=crvcoilpts_5, Degree=3, Periodic=False, KnotStyle=1)  # -> Curve, Length, Domain
contour_2 = Contour(Shape=rulesrf_6, Point=Point(0, 0, 0), Direction="{0,3,0.5}", Distance=Slider(4, range=0..10))
pipe_5 = Pipe(Curve=[intcrv_5.Curve, intcrv_7.Curve, intcrv_6.Curve], Radius=Slider(0.25, range=0..1), Caps=0)

# ----
panel_39 = Panel(addition_7)
crv_19 = Curve([crv_18, crv_17, crv_16, crv_15, crv_14, crv_13])

# ---- group: RODS
crv_20 = Curve([item_7, item_4, item_5, item_6, crv_13, crv_14, crv_15, crv_16, crv_17, crv_18])
pipe_6 = Pipe(Curve=crv_20, Radius=Slider(0.9, range=0..1), Caps=0)

# ----
pipe_7 = Pipe(Curve=crv_19, Radius=Slider(1.4, range=0..10), Caps=0)
ptdividelen = DivideLength(Curve=contour, Distance=Slider(3, range=0..10), RoundUp=False, RoundDn=False)
pline_5 = PolyLine(Vertices=ptdividelen, Closed=False)
flatten_5 = FlattenTree(Tree=ptdividelen, Path="{0}")
explode_5 = Explode(Curve=pline_5, Recursive=True)  # -> Segments, Vertices
dispatch_7 = Dispatch(List=explode_5.Segments, DispatchPattern=panel)  # -> ListA, ListB
crv_21 = Curve(dispatch_7.ListA)

# ==== cluster Seam
L = ClusterInput()
i = ClusterInput()
xz = XZPlane(Origin=Point(0, 0, 0))
item = ListItem(List=L, Index=i, Wrap=True)
D = ClusterInput()
i_2 = ClusterOutput(item)
offset = OffsetCurve(Curve=item, Distance=D, Plane=xz, Corners=1)
end = EndPoints(Curve=offset)  # -> Start, End
C = ClusterOutput(offset)
end_2 = EndPoints(Curve=item)  # -> Start, End
ln = Line(StartPoint=end_2.End, EndPoint=end.End)
ln_2 = Line(StartPoint=end_2.Start, EndPoint=end.Start)
L_2 = ClusterOutput(ln)
L_3 = ClusterOutput(ln_2)
